# Dynamo graph AllplanAttributeCollection-Example.dyn (Dynamo 2.5.0.7186)
# packages: IlseDynamo 0.1.0

file_path = Filename("..\IlseDynamo.Tests\Resources\AttributeDefinitionCollectionLocal_de.xml")
byFileName = Allplan.AttributeDefinition.ByFileName(fileName=file_path)
toData = Allplan.AttributeDefinition.ToData(attributeDefinition=byFileName)
watch = Watch(toData.ifnr)
watch_2 = Watch(toData.name)
watch_3 = Watch(toData.datatype)
diff = Allplan.AttributeDefinition.Diff(left=byFileName, right=byFileName)
watch_4 = Watch(diff.equal)
watch_5 = Watch(diff.leftConflicts)
watch_6 = Watch(diff.rightConflicts)
watch_7 = Watch(diff.onlyLeft)
watch_8 = Watch(diff.onlyRight)
toData_2 = Allplan.AttributeDefinition.ToData(attributeDefinition=diff.equal)
watch_9 = Watch(toData_2.name)
