# Dynamo graph AllplanAttributeFavourite-Example.dyn (Dynamo 2.5.0.7186)
# packages: IlseDynamo 0.1.0

file_path = Filename("out\AllplanAttributeFavourite-Example.xlsx")
file_path_2 = Filename("..\IlseDynamo.Tests\Resources\AttributeFavourite.atfanfx")
code_block = CodeBlock { ""; }
byFileName = Allplan.AttributeFavourite.ByFileName(fileName=file_path_2, basePath=code_block)
file_path_3 = Filename("..\IlseDynamo.Tests\Resources\AttributeDefinitionCollectionLocal_de.xml")
byFileName_2 = Allplan.AttributeDefinition.ByFileName(fileName=file_path_3)
toData = Allplan.AttributeFavourite.ToData(attributeFavourite=byFileName, attributeDefinition=byFileName_2)
watch = Watch(toData.name)
watch_2 = Watch(toData.value)
watch_3 = Watch(toData.unknown)
name = Allplan.AttributeFavourite.Name(attributeFavourite=byFileName)
watch_4 = Watch(name)
