# Dynamo graph AllplanAttributeLevel-Example.dyn (Dynamo 2.5.0.7186)
# packages: IlseDynamo 0.1.0

code_block = CodeBlock { ""; }

# group: Reading definition and favourite template
file_path = Filename("..\IlseDynamo.Tests\Resources\AttributeFavourite.atfanfx")
byFileName = Allplan.AttributeFavourite.ByFileName(fileName=file_path, basePath=code_block)
file_path_2 = Filename("..\IlseDynamo.Tests\Resources\AttributeDefinitionCollectionLocal_de.xml")
byFileName_2 = Allplan.AttributeDefinition.ByFileName(fileName=file_path_2)

# group: Example LoI definition of 3 levels
code_block_2 = CodeBlock { [1,2,3]; }
code_block_3 = CodeBlock { ["Schutzwandbauteil","Schalldaemmung", "Datenquelle"]; }
byData = Allplan.AttributeMatrix.ByData(levels=code_block_2, attributeNames=code_block_3)
code_block_4 = CodeBlock { [1,2,3]; }
allUpToLevel = Allplan.AttributeMatrix.AllUpToLevel(attributeMatrix=byData, level=code_block_4)

ofLevel = Allplan.AttributeFavourite.OfLevel(attributeFavourite=byFileName, attributeLevel=allUpToLevel, attributeDefinition=byFileName_2)
toData = Allplan.AttributeFavourite.ToData(attributeFavourite=ofLevel)
watch = Watch(toData.ifnr)
watch_2 = Watch(toData.value)
toData_2 = Allplan.AttributeFavourite.ToData(attributeFavourite=ofLevel, attributeDefinition=byFileName_2)
watch_3 = Watch(toData_2.name)
watch_4 = Watch(toData_2.value)
